# Grasshopper definition Grasshopper-laser-cut-1.gh (Grasshopper 1.0.7)

of_wedges = Slider(4, range=0..25)
rectangle = Rectangle(Plane=PlaneXY(0, 0, 0), XSize=Slider(2, range=0..100), YSize=Slider(10, range=0..100), Radius=0)  # -> Rectangle, Length
circle = Circle(Plane=PlaneXY(0, 0, 0), Radius=Slider(10, range=0..100))
vector_xyz = VectorXYZ(XComponent=Slider(-1, range=-100..100), YComponent=Slider(4, range=0..100), ZComponent=0)  # -> Vector, Length
move = Move(Geometry=rectangle.Rectangle, Motion=vector_xyz.Vector)  # -> Geometry, Transform
curve = Curve(circle)
polar_array = PolarArray(Geometry=move.Geometry, Plane=PlaneXY(0, 0, 0), Count=of_wedges, Angle=6.283185307)  # -> Geometry, Transform
trim_with_region = TrimWithRegion(Curve=polar_array.Geometry, Region=curve)  # -> Inside, Outside
trim_with_region_2 = TrimWithRegion(Curve=curve, Region=polar_array.Geometry)  # -> Inside, Outside
group = Group(Objects=[circle, polar_array.Geometry])
curve_2 = Curve(flatten(trim_with_region.Inside))
curve_3 = Curve(flatten(trim_with_region_2.Outside))
curve_4 = Curve(trim_with_region.Outside)
curve_5 = Curve(trim_with_region_2.Inside)
panel = Panel(curve_2)
panel_2 = Panel(curve_3)
join_curves = JoinCurves(Curves=[curve_3, curve_2], Preserve=False)
